# Dynamo graph Building Generator.dyn (Dynamo 2.0.2.6826)

string = StringInput("D")
XY = Plane.XY()
number = DoubleInput(30)
number_2 = DoubleInput(30)
number_3 = DoubleInput(5)
number_4 = DoubleInput(500)
number_5 = DoubleInput(10)
boolean = BoolSelector(false)
buildingGenerator = Buildings.Creation.BuildingGenerator(Type=string, BasePlane=XY, Length=number, Width=number_2, Depth=number_3, BldgArea=number_4, FloorHeight=number_5, CreateCore=boolean)
